# Grasshopper definition 0115 螺旋.gh (Grasshopper 1.0.8)

slot_height = Slider(2.303, range=1..50)
end_gap = Slider(8.285, range=0..20)
total_length = Slider(92.052, range=10..200)
slot_width = Slider(1.57, range=1..50)
core_radius = Slider(11.537, range=1..50)
flange_thickness = Slider(2.871, range=0.1..10)
flange_width = Slider(3.747, range=1..50)
turns = Slider(11, range=1..20)
resolution = Panel("100")
half_slot_height = Division(A=slot_height, B="2")
cutter_length = Multiplication(A=core_radius, B="2.2")
angle_step_size = Expression(x=resolution, Expression="2*pi/x")
total_gap = Multiplication(A=end_gap, B="2")
Z = UnitZ(Factor=flange_thickness)
outer_radius = Addition(A=core_radius, B=flange_width)
total_steps = Multiplication(A=turns, B=resolution)
core_cylinder = Cylinder(Base=PlaneXY(0, 0, 0), Radius=core_radius, Length=total_length)
debrep = DeconstructBrep(Brep=core_cylinder)  # -> Faces, Edges, Vertices
top_plane_z = Subtraction(A=total_length, B=half_slot_height)
bottom_plane_origin = ConstructPoint(XCoordinate=0, YCoordinate=0, ZCoordinate=half_slot_height)
angles = Series(Start=0, Step=angle_step_size, Count=total_steps)
helix_length = Subtraction(A=total_length, B=total_gap)
item = ListItem(List=debrep.Edges, Index=Slider(0, range=0..10), Wrap=True)
bottom_plane = XYPlane(Origin=bottom_plane_origin)
top_plane_origin = ConstructPoint(XCoordinate=0, YCoordinate=0, ZCoordinate=top_plane_z)
crv = Curve(item)
pitch = Division(A=helix_length, B=turns)
sin = Sine(Value=angles)
cos = Cosine(Value=angles)
Z_2 = UnitZ(Factor=total_length)
boundary = BoundarySurfaces(Edges=crv)
top_plane = XYPlane(Origin=top_plane_origin)
bottom_cutter = CenterBox(Base=bottom_plane, X=cutter_length, Y=slot_width, Z=slot_height)
z_step_size = Division(A=pitch, B=resolution)
outer_y_coords = Multiplication(A=sin, B=outer_radius)
outer_x_coords = Multiplication(A=cos, B=outer_radius)
inner_y_coords = Multiplication(A=sin, B=core_radius)
inner_x_coords = Multiplication(A=cos, B=core_radius)
extr = Extrude(Base=boundary, Direction=Z_2)
z_coords = Series(Start=end_gap, Step=z_step_size, Count=total_steps)
top_cutter = CenterBox(Base=top_plane, X=cutter_length, Y=slot_width, Z=slot_height)
outer_points = ConstructPoint(XCoordinate=outer_x_coords, YCoordinate=outer_y_coords, ZCoordinate=z_coords)
inner_points = ConstructPoint(XCoordinate=inner_x_coords, YCoordinate=inner_y_coords, ZCoordinate=z_coords)
cut_cylinder = SolidDifference(BrepsA=extr, BrepsB=flatten([bottom_cutter, top_cutter]))
outer_helix = NurbsCurve(Vertices=outer_points, Degree=3, Periodic=False)  # -> Curve, Length, Domain
inner_helix = NurbsCurve(Vertices=inner_points, Degree=3, Periodic=False)  # -> Curve, Length, Domain
flange_surface = Loft(
    Curves=flatten([inner_helix.Curve, outer_helix.Curve]),
    Options={Adjust=False, Closed=False, LoftEnds=0, LoftSimp=0, LoftType=0, Rebuild=10, Refit=0.01})
thicken_flange = Extrude(Base=flange_surface, Direction=Z)
solid_flange = CapHoles(Brep=thicken_flange)
display = CustomPreview(
    Geometry=flatten([cut_cylinder, solid_flange]),
    Material={diffuse=RGB(228, 178, 227), emission=RGB(68, 53, 68), shine=0.5, specular=RGB(255, 254, 255), transparency=0})
